# Grasshopper definition metro.gh (Grasshopper 1.0.7)
# plug-ins: LunchBox

file_path = FilePath("C:\Users\bot\projects\munich_new_metro_pbd\data\munich.csv")
read_file = ReadFile(File=file_path, PerLineParse=True)
read_csv = ReadCSV(CSVString=read_file, Delimiter=";")  # -> Headers, Values
panel = Panel(read_csv.Values)
panel_2 = Panel(read_csv.Headers)
explode_tree = ExplodeTree(Data=read_csv.Values)  # -> Branch0, Branch1, Branch2, Branch3, Branch4, Branch5
panel_3 = Panel(explode_tree.Branch0)
panel_4 = Panel(explode_tree.Branch2)
panel_5 = Panel(explode_tree.Branch5)
panel_6 = Panel(explode_tree.Branch1)
parse_polygon = CSharpScript(x=explode_tree.Branch2)  # -> out, A; inputs x: String
# ---------- parse_polygon: C# ----------
    List<string> outList = new List<string>();
    var cleanString = x.Substring(10, x.Length - 2-10);
    outList.Add(cleanString);
    A = outList;
# ---------- end parse_polygon ----------
polyline = PolyLine(Closed=True)
panel_7 = Panel(parse_polygon.out)
panel_8 = Panel(parse_polygon.A)
polyline_2 = PolyLine(Closed=True)
